# Dynamo graph Copy Elements from LInked model.dyn (Dynamo 2.18.1.5096)
# packages: archi-lab.net 2024.217.1024, bimorphNodes 5.1.3, Orchid 2.19.5.6577

getDocuments = archilab.Revit.Selection.Select.GetDocuments()
enter_category_1 = StringInput("Mechanical Equipment")  # graph input
byName = Category.ByName(name=enter_category_1)
ofCategory = Revit.LinkElement.OfCategory(linkInstance=getDocuments.Link_Instance, category=byName)
clean = List.Clean(list=ofCategory)
copyElement = Orchid.RevitProject.Common.Link.CopyElement(instance=getDocuments.Link_Instance, element=clean)
byElements = Group.ByElements(elements=copyElement)
enter_category_2 = StringInput("Ducts")  # graph input
byName_2 = Category.ByName(name=enter_category_2)
ofCategory_2 = Revit.LinkElement.OfCategory(linkInstance=getDocuments.Link_Instance, category=byName_2)
clean_2 = List.Clean(list=ofCategory_2)
copyElement_2 = Orchid.RevitProject.Common.Link.CopyElement(instance=getDocuments.Link_Instance, element=clean_2)
byElements_2 = Group.ByElements(elements=copyElement_2)
enter_category_3 = StringInput("Duct Fittings")  # graph input
byName_3 = Category.ByName(name=enter_category_3)
ofCategory_3 = Revit.LinkElement.OfCategory(linkInstance=getDocuments.Link_Instance, category=byName_3)
clean_3 = List.Clean(list=ofCategory_3)
copyElement_3 = Orchid.RevitProject.Common.Link.CopyElement(instance=getDocuments.Link_Instance, element=clean_3)
byElements_3 = Group.ByElements(elements=copyElement_3)
