# Dynamo graph Delete Arch Columns.dyn (Dynamo 2.17.0.3472)
# packages: archi-lab.net 2024.217.1024

categories = Categories("OST_Columns")
all_elements_of_category = ElementsOfCategory(Category=categories)
delete = archilab.Revit.Elements.Elements.Delete(element=all_elements_of_category)
