# Dynamo graph Duplicate STR Column Types With Arch Column Types.dyn (Dynamo 2.17.0.3472)
# packages: archi-lab.net 2024.217.1024, Clockwork for Dynamo 2.x 2.12.2, Universo_BIM 19.10.11

select_structural_column_family = FamilyTypes("Family100:SC_Columna Concreto 50X50")  # "Select Structural Column Family Type"; graph input
select_arch_column_family_type = Categories("OST_Columns")  # "Select Arch Column Family Type Which Need to be Converted"; graph input
all_elements_of_category = ElementsOfCategory(Category=select_arch_column_family_type)
familyType = Custom[FamilyInstance.FamilyType](familyInstance=all_elements_of_category)  # package archi-lab.net; This node will return a Family Type of a given Family Instance. If no Family Type can be assigned to a Family then it will return Null.
take_a_snap_to_select_these = List.UniqueItems(list=familyType)  # "Take a Snap to Select These Family Types in the same order Type1..Type2.. in your next step"; graph output
code_block = CodeBlock(x=take_a_snap_to_select_these) { x[0]; }
byFamilyType = FamilyInstance.ByFamilyType(familyType=code_block)
type = Elements.Element.Type(element=byFamilyType)
code_block_2 = CodeBlock { "Type Name"; }
getParameterValueByName = Element.GetParameterValueByName(element=type, parameterName=code_block_2)
uniqueItems = List.UniqueItems(list=getParameterValueByName)
duplicate = Custom[FamilyType.Duplicate](elementType=select_structural_column_family, name=uniqueItems@L1)  # package Clockwork for Dynamo 2.x; Duplicates a family type
code_block_3 = CodeBlock(x=take_a_snap_to_select_these) { x[1]; }
byFamilyType_2 = FamilyInstance.ByFamilyType(familyType=code_block_3)
type_2 = Elements.Element.Type(element=byFamilyType_2)
code_block_4 = CodeBlock { "Type Name"; }
getParameterValueByName_2 = Element.GetParameterValueByName(element=type_2, parameterName=code_block_4)
uniqueItems_2 = List.UniqueItems(list=getParameterValueByName_2)
duplicate_2 = Custom[FamilyType.Duplicate](elementType=select_structural_column_family, name=uniqueItems_2@L1)
code_block_5 = CodeBlock(x=take_a_snap_to_select_these) { x[2]; }
byFamilyType_3 = FamilyInstance.ByFamilyType(familyType=code_block_5)
type_3 = Elements.Element.Type(element=byFamilyType_3)
code_block_6 = CodeBlock { "Type Name"; }
getParameterValueByName_3 = Element.GetParameterValueByName(element=type_3, parameterName=code_block_6)
uniqueItems_3 = List.UniqueItems(list=getParameterValueByName_3)
duplicate_3 = Custom[FamilyType.Duplicate](elementType=select_structural_column_family, name=uniqueItems_3@L1)
code_block_7 = CodeBlock(x=take_a_snap_to_select_these) { x[3]; }
byFamilyType_4 = FamilyInstance.ByFamilyType(familyType=code_block_7)
type_4 = Elements.Element.Type(element=byFamilyType_4)
code_block_8 = CodeBlock { "Type Name"; }
getParameterValueByName_4 = Element.GetParameterValueByName(element=type_4, parameterName=code_block_8)
uniqueItems_4 = List.UniqueItems(list=getParameterValueByName_4)
duplicate_4 = Custom[FamilyType.Duplicate](elementType=select_structural_column_family, name=uniqueItems_4@L1)
