# Dynamo graph Place Structural Column Family Instances.dyn (Dynamo 2.17.0.3472)
# packages: Universo_BIM 19.10.11, archi-lab.net 2024.217.1024, Clockwork for Dynamo 2.x 2.12.2

select_type1_str_column_family = FamilyTypes("Family100:450x600mm")  # graph input
select_arch_column_family_type = Categories("OST_Columns")  # "Select Arch Column Family Type that Need to be Converted"; graph input
all_elements_of_category = ElementsOfCategory(Category=select_arch_column_family_type)
familyType = Custom[FamilyInstance.FamilyType](familyInstance=all_elements_of_category)  # package archi-lab.net; This node will return a Family Type of a given Family Instance. If no Family Type can be assigned to a Family then it will return Null.
uniqueItems = List.UniqueItems(list=familyType)
code_block = CodeBlock(x=uniqueItems) { x[0]; }
byFamilyType = FamilyInstance.ByFamilyType(familyType=code_block)
code_block_2 = CodeBlock()
# ---------- code_block_2.designscript (2 lines) ----------
["Width",
"Depth"];
# ----------------------------------------
type = Elements.Element.Type(element=byFamilyType)
code_block_3 = CodeBlock()  # same code as code_block_2
getParameterValueByName = Element.GetParameterValueByName(element=type, parameterName=code_block_3)
select_type2_str_column_family = FamilyTypes("Family100:300 X 600")  # "Select Type2 Str. Column Family Type"; graph input
code_block_4 = CodeBlock(x=uniqueItems) { x[1]; }
byFamilyType_2 = FamilyInstance.ByFamilyType(familyType=code_block_4)
code_block_5 = CodeBlock()  # same code as code_block_2
type_2 = Elements.Element.Type(element=byFamilyType_2)
code_block_6 = CodeBlock()  # same code as code_block_2
getParameterValueByName_2 = Element.GetParameterValueByName(element=type_2, parameterName=code_block_6)
select_type3_str_column_family = FamilyTypes("Family100:250 X 400")  # "Select Type3 Str. Column Family Type"; graph input
code_block_7 = CodeBlock(x=uniqueItems) { x[2]; }
byFamilyType_3 = FamilyInstance.ByFamilyType(familyType=code_block_7)
code_block_8 = CodeBlock()  # same code as code_block_2
type_3 = Elements.Element.Type(element=byFamilyType_3)
code_block_9 = CodeBlock()  # same code as code_block_2
getParameterValueByName_3 = Element.GetParameterValueByName(element=type_3, parameterName=code_block_9)
select_type4_str_column_family = FamilyTypes("Family100:350 X 450")  # "Select Type4 Str. Column Family Type"; graph input
code_block_10 = CodeBlock(x=uniqueItems) { x[3]; }
byFamilyType_4 = FamilyInstance.ByFamilyType(familyType=code_block_10)

# group: Locations
getLocation = Element.GetLocation(element=byFamilyType)
getLocation_2 = Element.GetLocation(element=byFamilyType_2)
getLocation_3 = Element.GetLocation(element=byFamilyType_3)
getLocation_4 = Element.GetLocation(element=byFamilyType_4)

# group: Level
level = Custom[Element.Level](element=byFamilyType)  # package Clockwork for Dynamo 2.x; Gets an element's level
level_2 = Custom[Element.Level](element=byFamilyType_2)
level_3 = Custom[Element.Level](element=byFamilyType_3)
level_4 = Custom[Element.Level](element=byFamilyType_4)

byPointAndLevel = FamilyInstance.ByPointAndLevel(familyType=select_type1_str_column_family, point=getLocation, level=level)
type_4 = Elements.Element.Type(element=byPointAndLevel)
setParameterByName = Element.SetParameterByName(element=type_4, parameterName=code_block_2, value=getParameterValueByName)
byPointAndLevel_2 = FamilyInstance.ByPointAndLevel(familyType=select_type2_str_column_family, point=getLocation_2, level=level_2)
type_5 = Elements.Element.Type(element=byPointAndLevel_2)
setParameterByName_2 = Element.SetParameterByName(element=type_5, parameterName=code_block_5, value=getParameterValueByName_2)
byPointAndLevel_3 = FamilyInstance.ByPointAndLevel(familyType=select_type3_str_column_family, point=getLocation_3, level=level_3)
type_6 = Elements.Element.Type(element=byPointAndLevel_3)
setParameterByName_3 = Element.SetParameterByName(element=type_6, parameterName=code_block_8, value=getParameterValueByName_3)
byPointAndLevel_4 = FamilyInstance.ByPointAndLevel(familyType=select_type4_str_column_family, point=getLocation_4, level=level_4)
type_7 = Elements.Element.Type(element=byPointAndLevel_4)
code_block_11 = CodeBlock()  # same code as code_block_2
type_8 = Elements.Element.Type(element=byFamilyType_4)
code_block_12 = CodeBlock()  # same code as code_block_2
getParameterValueByName_4 = Element.GetParameterValueByName(element=type_8, parameterName=code_block_12)
setParameterByName_4 = Element.SetParameterByName(element=type_7, parameterName=code_block_11, value=getParameterValueByName_4)
