# Dynamo graph Reset Graphic Overrides.dyn (Dynamo 2.18.1.5096)
# packages: Clockwork for Dynamo 2.x 2.12.2

all_elements_in_active_view = ElementsInView()
current = Document.Current()
activeView = Document.ActiveView(document=current)
resetElementOverrides = Custom[View.ResetElementOverrides](element=all_elements_in_active_view, view=activeView)  # package Clockwork for Dynamo 2.x; Resets all overrides for an element in a given view
