# Dynamo graph Warning Type.dyn (Dynamo 2.18.1.5096)
# packages: Bang! 2021.4.3

select_warning_type = WarningsOfType("Highlighted walls are attached to, but miss, .....")  # graph input
failingElements = Bang.Revit.Elements.Warning.FailingElements(warning=select_warning_type)
flatten = List.Flatten(list=failingElements)
uniqueItems = List.UniqueItems(list=flatten)
code_block = CodeBlock { 255; 125; 0; }
byARGB = Color.ByARGB(alpha=code_block.out0, red=code_block.out2, green=code_block.out1, blue=code_block.out0)
byARGB_2 = Color.ByARGB(alpha=code_block.out0, blue=code_block.out2)
fill_patterns = FillPatterns("<Solid fill>")
byProperties = Revit.Filter.OverrideGraphicSettings.ByProperties(projectionFillColor=byARGB, projectionLineColor=byARGB_2, projectionFillPattern=fill_patterns)
overrideInView = Element.OverrideInView(element=uniqueItems, overrides=byProperties)
